# Grasshopper definition create_run_data.ghx (Grasshopper 1.0.7)

# ----
# Configuration
path = FilePath("C:\rcf_robotcontrol\01_confs\201118.yaml")
panel = Panel(path)

path_2 = FilePath("C:\rcf_robotcontrol\03_run_data\")
path_3 = FilePath("C:\rcf_robotcontrol\04_logs\")

# ----
# Planes
pln = Plane([Plane(origin=(10726.55269, 20662.04128, 2745.125692), x=(0.5508569851, -0.667801758, -0.5005970376), y=(-0.7712412839, -0.6365427328, 0.000480841041)), Plane(origin=(10800.37814, 20584.23026, 2745.04834), x=(0.5375705796, -0.7101895092, -0.4545863317), y=(-0.7971792273, -0.6037425116, 0.0005092512443)), Plane(origin=(10871.31206, 20504.86099, 2744.972977), x=(0.5367773955, -0.7388812773, -0.4073382939), y=(-0.8089066361, -0.5879368855, 0.0005223166998)), Plane(origin=(10940.83496, 20425.665, 2744.898797), x=(0.5483409582, -0.7552838208, -0.3589826509), y=(-0.8091050131, -0.5876638535, 0.0005225389907)), Plane(origin=(11010.24756, 20348.11998, 2744.825078), x=(0.5717544257, -0.7597451776, -0.3096516459), y=(-0.7989165814, -0.6014416303, 0.0005111776477)), Plane(origin=(11080.63355, 20273.62976, 2744.751261), x=(0.6065183135, -0.7515355459, -0.2594799774), y=(-0.7781072252, -0.6281312822, 0.0004883002248))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])

# ----
# IDs
txt = Text(["3CC-00-000", "3CC-00-001", "3CC-00-002", "3CC-00-003", "3CC-00-004", "3CC-00-005", "3CC-00-006", "3CC-00-007", "3CC-00-008", "3CC-00-009", "3CC-00-010", "3CC-00-011", "3CC-00-012", "3CC-00-013", "3CC-00-014", "3CC-00-015", "3CC-00-016", "3CC-00-017", "3CC-00-018", "3CC-00-019", "3CC-00-020", "3CC-00-021", "3CC-00-022", "3CC-01-000", "3CC-01-001", "3CC-01-002", "3CC-01-003", "3CC-01-004", "3CC-01-005", "3CC-01-006", "3CC-01-007", "3CC-01-008", "3CC-01-009", "3CC-01-010", "3CC-01-011"])

# ----
# Compression
# (old format
# (0-1, larger number = less compression))
num = Number(0.37)

two_tables = FilePath("C:\rcf_robotcontrol\02_pick_frame_lists\201027-right-pick-conf_twotray.json")

# ---- group: Transformation WCS to RCS
transform = Transform({TransformCount=1, Name="Generic", m00=0.002792822373, m01=-0.999988732, m02=0.003838757276, m03=21588.98805, m10=0.9999960537, m11=0.002793970042, m12=0.000293638795, m13=-11983.05048, m20=-0.0003043608591, m21=0.003837922046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})

# ----
# Save file
save_json_file = Button()

bang = Button()

# ----
# Pick frame list
panel_2 = Panel(two_tables)

# ----
# Save directory
panel_3 = Panel(path_2)

# ----
# Folder for log files
panel_4 = Panel(path_3)

unload = PythonScript(bang=bang, module="rapid_clay_formations_fab")
# ---------- unload: Python ----------
import sys

def unload_modules(top_level_module_name):
    """Unloads all modules named starting with the specified string.

    This function eases the development workflow when editing a library that is
    used from Rhino/Grasshopper.

    Args:
        top_level_module_name (:obj:`str`): Name of the top-level module to unload.

    Returns:
        list: List of unloaded module names.
    """
    modules = filter(lambda m: m.startswith(top_level_module_name), sys.modules)

    for module in modules:
        sys.modules.pop(module)

    return modules

unload_modules(module)
# ---------- end unload ----------
file = ReadFile(File=path, PerLineParse=False)
panel_5 = Panel(file)
egress_distance = Slider(150, range=0..1000)

# ----
# PlaceElement creation
number_slider = Slider(45, range=0..100)
number_slider_2 = Slider(150, range=0..200)
transform_2 = Transform(Geometry=pln, Transform=transform)  # -> flatten(Geometry)
pln_2 = Plane(transform_2)
create_placeelement_objects = GhPythonScript(
    planes=pln_2,
    radius=number_slider,
    height=number_slider_2,
    compression=num,
    id=txt,
    egress_frame_distance=egress_distance,
    create_meshes=Toggle(True),
    u_res=Slider(20, range=0..25))  # -> out, elements, planes, meshes, egress_planes; inputs planes: list of Plane, compression: list, id: list, egress_frame_distance: list of Int32, create_meshes: Boolean, u_res: Int32
# ---------- create_placeelement_objects: Python ----------
from rapid_clay_formations_fab.utils import wrap_list
from rapid_clay_formations_fab.fab_data import PlaceElement
from rapid_clay_formations_fab.rhino import cgframe_to_rgplane
from rapid_clay_formations_fab.rhino import rgplane_to_cgframe

if len(planes) != len(id) and len(id) != 0:
    raise Exception("Different amount of planes and ids")

elements = []
for i, plane in enumerate(planes):

    kwargs = {}

    # Following keyword arguments are assumed to be one per element

    # Assumed same for whole series
    kwargs['radius'] = radius
    kwargs['height'] = height
    
    # Could be specific to each element
    kwargs['compression_ratio'] = compression[i % len(compression)]

    if len(egress_frame_distance) > 0:
        dist = egress_frame_distance[i % len(egress_frame_distance)]
        kwargs['egress_frame_distance'] = dist

    elements.append(PlaceElement(rgplane_to_cgframe(plane), id[i], **kwargs))

location_frames = [elem.location for elem in elements]
location_planes = [elem.get_location_rgplane() for elem in elements]

egress_frames = [elem.get_egress_frame() for elem in elements]
egress_planes = [cgframe_to_rgplane(frame) for frame in egress_frames]

if create_meshes:
    meshes = [elem.get_rgmesh(u_res=u_res) for elem in elements]
# ---------- end create_placeelement_objects ----------

# ----
# PickStation
number_slider_3 = Slider(225, range=0..1000)
python = GhPythonScript(
    pick_frames_path=two_tables,
    elem_height=number_slider_2,
    elem_egress_distance=number_slider_3,
    station_egress_distance=Slider(400, range=0..1000),
    rotation=Slider(90, range=-360..360))  # -> out, pick_station, pick_planes
# ---------- python: Python ----------
import math

from compas.geometry import Frame
from compas.geometry import Rotation
from compas import json_load

from rapid_clay_formations_fab.robots import PickStation
from rapid_clay_formations_fab.rhino import cgframe_to_rgplane

pick_frames = json_load(pick_frames_path)

if rotation:
    for f in pick_frames:
        R = Rotation.from_axis_and_angle(f.zaxis, math.radians(rotation), f.point)
        f.transform(R)
 
pick_station = PickStation(pick_frames,
                            elem_height=elem_height,
                            elem_egress_distance=elem_egress_distance,
                            )

pick_planes = [cgframe_to_rgplane(f) for f in pick_frames]
# ---------- end python ----------

pln_3 = Plane(create_placeelement_objects.planes)
pln_4 = Plane(create_placeelement_objects.egress_planes)

# ---- group: Clay bullet visualization
# PlaceElement meshes
mesh = Mesh(create_placeelement_objects.meshes)

# ----
python_2 = GhPythonScript(
    fab_data=simplify(create_placeelement_objects.elements),
    xform=transform,
    conf_path=path,
    pick_station=python.pick_station,
    log_dir=path_3,
    save_dir=path_2)  # -> out; inputs fab_data: list, xform: Transform, save: Boolean
# ---------- python_2: Python ----------
import os
import datetime

import System
import Rhino.Geometry as rg

from compas import json_dump

from rapid_clay_formations_fab.rhino import rgtransform_to_matrix
from rapid_clay_formations_fab.rhino import rgplane_to_cgframe
from rapid_clay_formations_fab import __version__

if fab_data is None:
    raise Exception("No fab_data specified.")

run_data = {}

run_data["fab_data"] = fab_data
run_data["conf_path"] = conf_path
run_data["pick_station"] = pick_station

run_data["log_dir"] = log_dir

datetime_now = datetime.datetime.now()
iso_timestamp = datetime_now.isoformat()

run_data["created"] = iso_timestamp

run_data["hostname"] = System.Net.Dns.GetHostName()
run_data["rcf_fab_version"] = __version__

run_data["xform"] = rgtransform_to_matrix(xform)

plane = rg.Plane.WorldXY.Clone()
plane.Transform(xform)

run_data["rcf"] = rgplane_to_cgframe(plane)

if save:
    # file name can not contain comma and [micro]seconds are overkill
    file_timestamp = datetime_now.strftime("%Y%m%dT%H.%M")

    file_name = file_timestamp + "-" + name + ".json"
    full_path = os.path.join(save_dir, file_name)
    with open(full_path, mode='w') as fp:
        json_dump(run_data, fp)
# ---------- end python_2 ----------

# ----
# Preview planes (Z should b down)
number_slider_4 = Slider(1, range=0..10)
cluster = Cluster(plane=flatten(pln_2), amplitude=Slider(51, range=0..100), R=number_slider_4)  # -> geo, color
preview = CustomPreview(Geometry=cluster.geo, Material=cluster.color)

# ==== cluster Cluster
plane = ClusterInput()
amplitude = ClusterInput()
R = ClusterInput()
deconstruct_plane = DeconstructPlane(Plane=graft(plane))  # -> Origin, XAxis, YAxis, ZAxis
amplitude_2 = Amplitude(Vector=deconstruct_plane.XAxis, Amplitude=amplitude)
amplitude_3 = Amplitude(Vector=deconstruct_plane.YAxis, Amplitude=amplitude)
amplitude_4 = Amplitude(Vector=deconstruct_plane.ZAxis, Amplitude=amplitude)
move = Move(Geometry=deconstruct_plane.Origin, Motion=amplitude_3)  # -> Geometry, Transform
move_2 = Move(Geometry=deconstruct_plane.Origin, Motion=amplitude_4)  # -> Geometry, Transform
move_3 = Move(Geometry=deconstruct_plane.Origin, Motion=amplitude_2)  # -> Geometry, Transform
ln = Line(StartPoint=deconstruct_plane.Origin, EndPoint=move.Geometry)
ln_2 = Line(StartPoint=deconstruct_plane.Origin, EndPoint=move_3.Geometry)
ln_3 = Line(StartPoint=deconstruct_plane.Origin, EndPoint=move_2.Geometry)
pipe = Pipe(Curve=ln, Radius=R, Caps=0)  # -> simplify(Pipe)
pipe_2 = Pipe(Curve=ln_2, Radius=R, Caps=0)  # -> simplify(Pipe)
pipe_3 = Pipe(Curve=ln_3, Radius=R, Caps=0)  # -> simplify(Pipe)
path_mapper = PathMapper(pipe_2, source="{*}", target="{0}")
path_mapper_2 = PathMapper(ColourSwatch(SwatchColor=RGB(255, 0, 0)), source="{*}", target="{0}")
path_mapper_3 = PathMapper(pipe, source="{*}", target="{1}")
path_mapper_4 = PathMapper(ColourSwatch(SwatchColor=RGB(0, 255, 0)), source="{*}", target="{1}")
path_mapper_5 = PathMapper(ColourSwatch(SwatchColor=RGB(0, 0, 255)), source="{*}", target="{2}")
path_mapper_6 = PathMapper(pipe_3, source="{*}", target="{2}")
data = Data([path_mapper_6, path_mapper_3, path_mapper])
data_2 = Data([path_mapper_5, path_mapper_4, path_mapper_2])
geo = ClusterOutput(data)
color = ClusterOutput(data_2)
